# Grasshopper definition super_advanced_script.ghx (Grasshopper 0.9.76)

addition = Addition(A="1000", B="1000")
division = Division(A=addition, B=Slider(4, range=0..10))
subtraction = Subtraction(A=division, B="1000")
panel = Panel(subtraction)
